test file "Model_Comparison"

suite "New Test Suite 1"

  case "Comparison Tests" [equivalence]
    description: Description:
      This report aims to check congruences and differences between two vehicle models: Dynamic model and Kinematic model.
      In all the comparisons, our Dynamic model is considered as the baseline.
      For the tests purposes we have not included Equivalence Criteria, indeed this will be a qualitative analysis.
      The only parameter we have set up is the relative tolerance, assigning to it a value of 1% in order to ignore the negligible offsets between the Dynamic and the Kinematic model.
    simulation 1:
      model Model_compare_SLX, harness Model_comparison_dynamic (for Model_compare_SLX/Dynamic_model), start time 0, stop time 10
      input "Free_evolution.mat", mapped to u, Param
      input "Only_throttle.mat", mapped to u, Param
      input "Constant_steering.mat", mapped to u, Param
      input "Ramp_steering.mat", mapped to u, Param
      input "Small_sinusoidal_steering.mat", mapped to u, Param
      input "Big_sinusoidal_steering.mat", mapped to u, Param
      input "Combined1.mat", mapped to u, Param
      input "Combined2.mat", mapped to u, Param
    simulation 2:
      model Model_compare_SLX, harness Model_comparison_kinematic (for Model_compare_SLX/Kinematic_model), start time 0, stop time 10
      input "Free_evolution.mat", mapped to Param, u
      input "Only_throttle.mat", mapped to Param, u
      input "Constant_steering.mat", mapped to Param, u
      input "Ramp_steering.mat", mapped to Param, u
      input "Small_sinusoidal_steering.mat", mapped to Param, u
      input "Big_sinusoidal_steering.mat", mapped to Param, u
      input "Combined1.mat", mapped to Param, u
      input "Combined2.mat", mapped to Param, u
      logged signals "Signal Set 1": Throttle, Steering
    equivalence criteria
      X: rel tol 0.01
      Y: rel tol 0.01
      yaw: rel tol 0.01
      V: rel tol 0.01
    iterations:
      Free evolution: ExternalInput "Free_evolution.mat", ExternalInput "Free_evolution.mat"  % Free Evolution Test performed starting from an initial condition with input equal to 0
      Only throttle: ExternalInput "Only_throttle.mat", ExternalInput "Only_throttle.mat"  % Only throttle Test performed keeping the steering angle equal to 0 and varying the throttle
      Constant steering: ExternalInput "Constant_steering.mat", ExternalInput "Constant_steering.mat"  % Constant steering Test performed keeping the throttle equal to 0 and giving a constant steering angle value
      Ramp steering: ExternalInput "Ramp_steering.mat", ExternalInput "Ramp_steering.mat"  % Ramp steering Test performed keeping the throttle equal to 0 and giving a ramp steering angle signal (from 0° to 36°)
      Small sinusoidal steering: ExternalInput "Small_sinusoidal_steering.mat", ExternalInput "Small_sinusoidal_steering.mat"  % Small sinusoidal steering Test performed keeping the throttle equal to 0 and giving a sinusoidal steering angle signal with frequency 0.2Hz and amplitude 5°
      Big sinusoidal steering: ExternalInput "Big_sinusoidal_steering.mat", ExternalInput "Big_sinusoidal_steering.mat"  % Big sinusoidal steering Test performed keeping the throttle equal to 0 and giving a sinusoidal steering angle signal with frequency 0.2Hz and amplitude 15°
      Combined 1: ExternalInput "Combined1.mat", ExternalInput "Combined1.mat"  % Combined 1 Throttle signal with a predefined shape and constant steering angle
      Combined 2: ExternalInput "Combined2.mat", ExternalInput "Combined2.mat"  % Combined 2 Ramp steering angle signal with a constant throttle