test file "Path_Following_test"
  description: These tests are aimed to evaluate the performance of a path follower in different scenarios

suite "Hyundai Azera"
  setup callback:
    param = loadParameters(1);

  case "Puglia" [simulation]
    description: This scenario is taken from an Highway and it is a road that is straigth for the most with some smooth corners.
      In this test we try to follow the path with a speed of 40 km/h.
    model Dynamic_obstacle_avoidance, harness Path_Following_Harness (for Dynamic_obstacle_avoidance/Subsystem)
    pre-load callback:
      %% Set Speed
      V = 40/3.6;
      %% Scenario Loading
      map = ScenarioLoading('puglia.mat');

      % Evaluate total distance covered by the route on the map
      distance = odometer(map);
      %% Reference signal
      % Upsample map based on speed and timestep
      [X_rec, Y_rec, Theta_rec] = reference_generator(map,V,Ts);
      % Extend the reference signal to avoid index over limits
      X_rec(end+1:end+p+20) = X_rec(end);
      Y_rec(end+1:end+p+20) = Y_rec(end);
      Theta_rec(end+1:end+p+20) = Theta_rec(end);
      % Define initial condition based on map
      x0_kin = [X_rec(1) Y_rec(1) Theta_rec(1) V]';
      x0_dyn = [X_rec(1) Y_rec(1) Theta_rec(1) V 0 0]';
      extended_map = [X_rec Y_rec Theta_rec repmat(V,length(X_rec),1)];
      egoStates.Plant = x0_kin';
      egoStates.Covariance = eye(6)*1000;

  case "Switzerland" [simulation]
    description: This is the slowest scenario considered, with lots of corners one after another.
      We try to follow this scenario with 15 km/h speed.
    model Dynamic_obstacle_avoidance, harness Path_Following_Harness (for Dynamic_obstacle_avoidance/Subsystem)
    parameter set "Parameter Set 1" (off):
      WOV = [30 30 10 30] (off)  % base workspace
    parameter set "Parameter Set 2" (off):
      WOV = [30 30 0 30] (off)  % base workspace
    parameter set "Parameter Set 3" (off):
      WOV = [30 30 1 30] (off)  % base workspace
    parameter set "Parameter Set 4" (off):
      WOV = [30 30 100 30] (off)  % base workspace
    pre-load callback:
      %% Set Speed
      V = 15/3.6;
      %% Scenario Loading
      map = ScenarioLoading('switzerland.mat');

      % Evaluate total distance covered by the route on the map
      distance = odometer(map);
      %% Reference signal
      % Upsample map based on speed and timestep
      [X_rec, Y_rec, Theta_rec] = reference_generator(map,V,Ts);
      % Extend the reference signal to avoid index over limits
      X_rec(end+1:end+p+20) = X_rec(end);
      Y_rec(end+1:end+p+20) = Y_rec(end);
      Theta_rec(end+1:end+p+20) = Theta_rec(end);
      % Define initial condition based on map
      x0_kin = [X_rec(1) Y_rec(1) Theta_rec(1) V]';
      x0_dyn = [X_rec(1) Y_rec(1) Theta_rec(1) V 0 0]';
      extended_map = [X_rec Y_rec Theta_rec repmat(V,length(X_rec),1)];
      egoStates.Plant = x0_kin';
      egoStates.Covariance = eye(6)*1000;
    iterations:
      Iteration1 (disabled): ParameterSet "Parameter Set 1"
      Iteration2 (disabled): ParameterSet "Parameter Set 2"
      Iteration3 (disabled): ParameterSet "Parameter Set 3"
      Iteration4 (disabled): ParameterSet "Parameter Set 4"

  case "Straight_Slow" [simulation]
    description: Sample scenario consisting in a straight line.
      Speed 10 km/h.
    model Dynamic_obstacle_avoidance, harness Path_Following_Harness (for Dynamic_obstacle_avoidance/Subsystem)
    pre-load callback:
      %% Set Speed
      V = 10/3.6;
      %% Scenario Loading
      map = [0 0; 1000 0];

      % Evaluate total distance covered by the route on the map
      distance = odometer(map);
      %% Reference signal
      % Upsample map based on speed and timestep
      [X_rec, Y_rec, Theta_rec] = reference_generator(map,V,Ts);
      % Extend the reference signal to avoid index over limits
      X_rec(end+1:end+p+20) = X_rec(end);
      Y_rec(end+1:end+p+20) = Y_rec(end);
      Theta_rec(end+1:end+p+20) = Theta_rec(end);
      % Define initial condition based on map
      x0_kin = [X_rec(1) Y_rec(1) Theta_rec(1) V]';
      x0_dyn = [X_rec(1) Y_rec(1) Theta_rec(1) V 0 0]';
      extended_map = [X_rec Y_rec Theta_rec repmat(V,length(X_rec),1)];
      egoStates.Plant = x0_kin';
      egoStates.Covariance = eye(6)*1000;

  case "TiltedStraight_Slow" [simulation]
    description: Sample scenario consisting in a straight line with a direction of 45 degrees in the X-Y plane.
      Speed 10 km/h.
    model Dynamic_obstacle_avoidance, harness Path_Following_Harness (for Dynamic_obstacle_avoidance/Subsystem)
    pre-load callback:
      %% Set Speed
      V = 10/3.6;

      %% Scenario Loading
      map = [0 0; 1000 1000];

      % Evaluate total distance covered by the route on the map
      distance = odometer(map);
      %% Reference signal
      % Upsample map based on speed and timestep
      [X_rec, Y_rec, Theta_rec] = reference_generator(map,V,Ts);
      % Extend the reference signal to avoid index over limits
      X_rec(end+1:end+p+20) = X_rec(end);
      Y_rec(end+1:end+p+20) = Y_rec(end);
      Theta_rec(end+1:end+p+20) = Theta_rec(end);
      % Define initial condition based on map
      x0_kin = [X_rec(1) Y_rec(1) Theta_rec(1) V]';
      x0_dyn = [X_rec(1) Y_rec(1) Theta_rec(1) V 0 0]';
      extended_map = [X_rec Y_rec Theta_rec repmat(V,length(X_rec),1)];
      egoStates.Plant = x0_kin';
      egoStates.Covariance = eye(6)*1000;

  case "Campania" [simulation]
    description: This scenario is made up by a sequence of smooth corners.
      We try to follow this path with 30 km/h speed.
    model Dynamic_obstacle_avoidance, harness Path_Following_Harness (for Dynamic_obstacle_avoidance/Subsystem)
    parameter set "Parameter Set 1" (off):
      WOV = [30 30 10 30] (off)  % base workspace
    parameter set "Parameter Set 2" (off):
      WOV = [30 30 0 30] (off)  % base workspace
    parameter set "Parameter Set 3" (off):
      WOV = [30 30 1 30] (off)  % base workspace
    parameter set "Parameter Set 4" (off):
      WOV = [30 30 100 30] (off)  % base workspace
    pre-load callback:
      %% Set Speed
      V = 30/3.6;
      %% Scenario Loading
      map = ScenarioLoading('campania.mat');

      % Evaluate total distance covered by the route on the map
      distance = odometer(map);
      %% Reference signal
      % Upsample map based on speed and timestep
      [X_rec, Y_rec, Theta_rec] = reference_generator(map,V,Ts);
      % Extend the reference signal to avoid index over limits
      X_rec(end+1:end+p+20) = X_rec(end);
      Y_rec(end+1:end+p+20) = Y_rec(end);
      Theta_rec(end+1:end+p+20) = Theta_rec(end);
      % Define initial condition based on map
      x0_kin = [X_rec(1) Y_rec(1) Theta_rec(1) V]';
      x0_dyn = [X_rec(1) Y_rec(1) Theta_rec(1) V 0 0]';
      extended_map = [X_rec Y_rec Theta_rec repmat(V,length(X_rec),1)];
      egoStates.Plant = x0_kin';
      egoStates.Covariance = eye(6)*1000;
    iterations:
      Iteration1 (disabled): ParameterSet "Parameter Set 1"
      Iteration2 (disabled): ParameterSet "Parameter Set 2"
      Iteration3 (disabled): ParameterSet "Parameter Set 3"
      Iteration4 (disabled): ParameterSet "Parameter Set 4"

  case "Straight_Fast" [simulation]
    description: Sample scenario consisiting in a straight line.
      Speed: 100 km/h.
    model Dynamic_obstacle_avoidance, harness Path_Following_Harness (for Dynamic_obstacle_avoidance/Subsystem)
    pre-load callback:
      %% Set Speed
      V = 100/3.6;
      %% Scenario Loading
      map = [0 0; 1000 0];

      % Evaluate total distance covered by the route on the map
      distance = odometer(map);
      %% Reference signal
      % Upsample map based on speed and timestep
      [X_rec, Y_rec, Theta_rec] = reference_generator(map,V,Ts);
      % Extend the reference signal to avoid index over limits
      X_rec(end+1:end+p+20) = X_rec(end);
      Y_rec(end+1:end+p+20) = Y_rec(end);
      Theta_rec(end+1:end+p+20) = Theta_rec(end);
      % Define initial condition based on map
      x0_kin = [X_rec(1) Y_rec(1) Theta_rec(1) V]';
      x0_dyn = [X_rec(1) Y_rec(1) Theta_rec(1) V 0 0]';
      extended_map = [X_rec Y_rec Theta_rec repmat(V,length(X_rec),1)];
      egoStates.Plant = x0_kin';
      egoStates.Covariance = eye(6)*1000;

  case "TiltedStraight_Fast" [simulation]
    description: Sample scenario consisting in a straight line tilted by 135 degrees in the X-Y plane.
      Speed: 100 km/h.
    model Dynamic_obstacle_avoidance, harness Path_Following_Harness (for Dynamic_obstacle_avoidance/Subsystem)
    pre-load callback:
      %% Set Speed
      V = 100/3.6;

      %% Scenario Loading
      map = [0 0; -1000 1000];

      % Evaluate total distance covered by the route on the map
      distance = odometer(map);
      %% Reference signal
      % Upsample map based on speed and timestep
      [X_rec, Y_rec, Theta_rec] = reference_generator(map,V,Ts);
      % Extend the reference signal to avoid index over limits
      X_rec(end+1:end+p+20) = X_rec(end);
      Y_rec(end+1:end+p+20) = Y_rec(end);
      Theta_rec(end+1:end+p+20) = Theta_rec(end);
      % Define initial condition based on map
      x0_kin = [X_rec(1) Y_rec(1) Theta_rec(1) V]';
      x0_dyn = [X_rec(1) Y_rec(1) Theta_rec(1) V 0 0]';
      extended_map = [X_rec Y_rec Theta_rec repmat(V,length(X_rec),1)];
      egoStates.Plant = x0_kin';
      egoStates.Covariance = eye(6)*1000;

  case "1000mCurve_Slow" [simulation]
    description: Sample scenario consisting in a constant curve with radius 1000m.
      Speed set to 20 km/h.
    model Dynamic_obstacle_avoidance, harness Path_Following_Harness (for Dynamic_obstacle_avoidance/Subsystem)
    pre-load callback:
      %% Set Speed
      V = 20/3.6;

      %% Scenario Loading
      [X_rec, Y_rec, Theta_rec] = curve_generator(1000,V,Ts);
      map = [X_rec Y_rec];
      distance = odometer(map);
      % Extend the reference signal to avoid index over limits
      X_rec(end+1:end+p+20) = X_rec(end);
      Y_rec(end+1:end+p+20) = Y_rec(end);
      Theta_rec(end+1:end+p+20) = Theta_rec(end);
      % Define initial condition based on map
      x0_kin = [X_rec(1) Y_rec(1) Theta_rec(1) V]';
      x0_dyn = [X_rec(1) Y_rec(1) Theta_rec(1) V 0 0]';
      extended_map = [X_rec Y_rec Theta_rec repmat(V,length(X_rec),1)];
      egoStates.Plant = x0_kin';
      egoStates.Covariance = eye(6)*1000;

  case "100mCurve_Slow" [simulation]
    description: Sample scenario consisting in a constant curve with radius 100m.
      Speed: 10 km/h.
    model Dynamic_obstacle_avoidance, harness Path_Following_Harness (for Dynamic_obstacle_avoidance/Subsystem)
    pre-load callback:
      %% Set Speed
      V = 10/3.6;

      %% Scenario Loading
      [X_rec, Y_rec, Theta_rec] = curve_generator(100,V,Ts);
      map = [X_rec Y_rec];
      distance = odometer(map);
      % Extend the reference signal to avoid index over limits
      X_rec(end+1:end+p+20) = X_rec(end);
      Y_rec(end+1:end+p+20) = Y_rec(end);
      Theta_rec(end+1:end+p+20) = Theta_rec(end);
      % Define initial condition based on map
      x0_kin = [X_rec(1) Y_rec(1) Theta_rec(1) V]';
      x0_dyn = [X_rec(1) Y_rec(1) Theta_rec(1) V 0 0]';
      extended_map = [X_rec Y_rec Theta_rec repmat(V,length(X_rec),1)];
      egoStates.Plant = x0_kin';
      egoStates.Covariance = eye(6)*1000;

  case "1000mCurve_Fast" [simulation]
    description: Sample scenario consisting in a constant curve with 1000m radius.
      Speed: 100 km/h.
    model Dynamic_obstacle_avoidance, harness Path_Following_Harness (for Dynamic_obstacle_avoidance/Subsystem)
    pre-load callback:
      %% Set Speed
      V = 100/3.6;

      %% Scenario Loading
      [X_rec, Y_rec, Theta_rec] = curve_generator(1000,V,Ts);
      map = [X_rec Y_rec];
      distance = odometer(map);
      % Extend the reference signal to avoid index over limits
      X_rec(end+1:end+p+20) = X_rec(end);
      Y_rec(end+1:end+p+20) = Y_rec(end);
      Theta_rec(end+1:end+p+20) = Theta_rec(end);
      % Define initial condition based on map
      x0_kin = [X_rec(1) Y_rec(1) Theta_rec(1) V]';
      x0_dyn = [X_rec(1) Y_rec(1) Theta_rec(1) V 0 0]';
      extended_map = [X_rec Y_rec Theta_rec repmat(V,length(X_rec),1)];
      egoStates.Plant = x0_kin';
      egoStates.Covariance = eye(6)*1000;

  case "100mCurve_Fast" [simulation]
    description: Sample scenario consisting of a constant curve with radius 100m.
      Speed: 100 km/h.
    model Dynamic_obstacle_avoidance, harness Path_Following_Harness (for Dynamic_obstacle_avoidance/Subsystem)
    pre-load callback:
      %% Set Speed
      V = 100/3.6;

      %% Scenario Loading
      [X_rec, Y_rec, Theta_rec] = curve_generator(100,V,Ts);
      map = [X_rec Y_rec];
      distance = odometer(map);
      % Extend the reference signal to avoid index over limits
      X_rec(end+1:end+p+20) = X_rec(end);
      Y_rec(end+1:end+p+20) = Y_rec(end);
      Theta_rec(end+1:end+p+20) = Theta_rec(end);
      % Define initial condition based on map
      x0_kin = [X_rec(1) Y_rec(1) Theta_rec(1) V]';
      x0_dyn = [X_rec(1) Y_rec(1) Theta_rec(1) V 0 0]';
      extended_map = [X_rec Y_rec Theta_rec repmat(V,length(X_rec),1)];
      egoStates.Plant = x0_kin';
      egoStates.Covariance = eye(6)*1000;

  case "Adriatic Highway A 14" [simulation]
    description: This scenario is taken from the A14 Highway which is a straight road for the most of it, with some high-speed corners.
      We simulate this scenario at 100 km/h.
    model Dynamic_obstacle_avoidance, harness Path_Following_Harness (for Dynamic_obstacle_avoidance/Subsystem)
    parameter set "Parameter Set 1" (off):
      WOV = [30 30 10 30] (off)  % base workspace
    parameter set "Parameter Set 2" (off):
      WOV = [30 30 0 30] (off)  % base workspace
    parameter set "Parameter Set 3" (off):
      WOV = [30 30 1 30] (off)  % base workspace
    parameter set "Parameter Set 4" (off):
      WOV = [30 30 100 30] (off)  % base workspace
    pre-load callback:
      %% Set Speed
      V = 100/3.6;
      %% Scenario Loading
      map = ScenarioLoading('A_14.mat');

      % Evaluate total distance covered by the route on the map
      distance = odometer(map);
      %% Reference signal
      % Upsample map based on speed and timestep
      [X_rec, Y_rec, Theta_rec] = reference_generator(map,V,Ts);
      % Extend the reference signal to avoid index over limits
      X_rec(end+1:end+p+20) = X_rec(end);
      Y_rec(end+1:end+p+20) = Y_rec(end);
      Theta_rec(end+1:end+p+20) = Theta_rec(end);
      % Define initial condition based on map
      x0_kin = [X_rec(1) Y_rec(1) Theta_rec(1) V]';
      x0_dyn = [X_rec(1) Y_rec(1) Theta_rec(1) V 0 0]';
      extended_map = [X_rec Y_rec Theta_rec repmat(V,length(X_rec),1)];
      egoStates.Plant = x0_kin';
      egoStates.Covariance = eye(6)*1000;
    iterations:
      Iteration1 (disabled): ParameterSet "Parameter Set 1"
      Iteration2 (disabled): ParameterSet "Parameter Set 2"
      Iteration3 (disabled): ParameterSet "Parameter Set 3"
      Iteration4 (disabled): ParameterSet "Parameter Set 4"

  case "Indianapolis Speedway" [simulation]
    description: This scenario is taken from the Indianapolis Speedway. We simulate it at 100 km/h.
    model Dynamic_obstacle_avoidance, harness Path_Following_Harness (for Dynamic_obstacle_avoidance/Subsystem)
    parameter set "Parameter Set 1" (off):
      WOV = [30 30 10 30] (off)  % base workspace
    parameter set "Parameter Set 2" (off):
      WOV = [30 30 0 30] (off)  % base workspace
    parameter set "Parameter Set 3" (off):
      WOV = [30 30 1 30] (off)  % base workspace
    parameter set "Parameter Set 4" (off):
      WOV = [30 30 100 30] (off)  % base workspace
    pre-load callback:
      %% Set Speed
      V = 100/3.6;
      %% Scenario Loading
      map = ScenarioLoading('indianapolis.mat');

      % Evaluate total distance covered by the route on the map
      distance = odometer(map);
      %% Reference signal
      % Upsample map based on speed and timestep
      [X_rec, Y_rec, Theta_rec] = reference_generator(map,V,Ts);
      % Extend the reference signal to avoid index over limits
      X_rec(end+1:end+p+20) = X_rec(end);
      Y_rec(end+1:end+p+20) = Y_rec(end);
      Theta_rec(end+1:end+p+20) = Theta_rec(end);
      % Define initial condition based on map
      x0_kin = [X_rec(1) Y_rec(1) Theta_rec(1) V]';
      x0_dyn = [X_rec(1) Y_rec(1) Theta_rec(1) V 0 0]';
      extended_map = [X_rec Y_rec Theta_rec repmat(V,length(X_rec),1)];
      egoStates.Plant = x0_kin';
      egoStates.Covariance = eye(6)*1000;
    iterations:
      Iteration1 (disabled): ParameterSet "Parameter Set 1"
      Iteration2 (disabled): ParameterSet "Parameter Set 2"
      Iteration3 (disabled): ParameterSet "Parameter Set 3"
      Iteration4 (disabled): ParameterSet "Parameter Set 4"

suite "BMW 325i"
  setup callback:
    param = loadParameters(2);

  case "Puglia" [simulation]
    description: This scenario is taken from an Highway and it is a road that is straigth for the most with some smooth corners.
      In this test we try to follow the path with a speed of 40 km/h.
    model Dynamic_obstacle_avoidance, harness Path_Following_Harness (for Dynamic_obstacle_avoidance/Subsystem)
    pre-load callback: same code as in pre-load callback of case "Puglia"

  case "Switzerland" [simulation]
    description: This is the slowest scenario considered, with lots of corners one after another.
      We try to follow this scenario with 15 km/h speed.
    model Dynamic_obstacle_avoidance, harness Path_Following_Harness (for Dynamic_obstacle_avoidance/Subsystem)
    parameter set "Parameter Set 1" (off):
      WOV = [30 30 10 30] (off)  % base workspace
    parameter set "Parameter Set 2" (off):
      WOV = [30 30 0 30] (off)  % base workspace
    parameter set "Parameter Set 3" (off):
      WOV = [30 30 1 30] (off)  % base workspace
    parameter set "Parameter Set 4" (off):
      WOV = [30 30 100 30] (off)  % base workspace
    pre-load callback: same code as in pre-load callback of case "Switzerland"
    iterations:
      Iteration1 (disabled): ParameterSet "Parameter Set 1"
      Iteration2 (disabled): ParameterSet "Parameter Set 2"
      Iteration3 (disabled): ParameterSet "Parameter Set 3"
      Iteration4 (disabled): ParameterSet "Parameter Set 4"

  case "Straight_Slow" [simulation]
    description: Sample scenario consisting in a straight line.
      Speed 10 km/h.
    model Dynamic_obstacle_avoidance, harness Path_Following_Harness (for Dynamic_obstacle_avoidance/Subsystem)
    pre-load callback: same code as in pre-load callback of case "Straight_Slow"

  case "TiltedStraight_Slow" [simulation]
    description: Sample scenario consisting in a straight line with a direction of 45 degrees in the X-Y plane.
      Speed 10 km/h.
    model Dynamic_obstacle_avoidance, harness Path_Following_Harness (for Dynamic_obstacle_avoidance/Subsystem)
    pre-load callback: same code as in pre-load callback of case "TiltedStraight_Slow"

  case "Campania" [simulation]
    description: This scenario is made up by a sequence of smooth corners.
      We try to follow this path with 30 km/h speed.
    model Dynamic_obstacle_avoidance, harness Path_Following_Harness (for Dynamic_obstacle_avoidance/Subsystem)
    parameter set "Parameter Set 1" (off):
      WOV = [30 30 10 30] (off)  % base workspace
    parameter set "Parameter Set 2" (off):
      WOV = [30 30 0 30] (off)  % base workspace
    parameter set "Parameter Set 3" (off):
      WOV = [30 30 1 30] (off)  % base workspace
    parameter set "Parameter Set 4" (off):
      WOV = [30 30 100 30] (off)  % base workspace
    pre-load callback: same code as in pre-load callback of case "Campania"
    iterations:
      Iteration1 (disabled): ParameterSet "Parameter Set 1"
      Iteration2 (disabled): ParameterSet "Parameter Set 2"
      Iteration3 (disabled): ParameterSet "Parameter Set 3"
      Iteration4 (disabled): ParameterSet "Parameter Set 4"

  case "Straight_Fast" [simulation]
    description: Sample scenario consisiting in a straight line.
      Speed: 100 km/h.
    model Dynamic_obstacle_avoidance, harness Path_Following_Harness (for Dynamic_obstacle_avoidance/Subsystem)
    pre-load callback: same code as in pre-load callback of case "Straight_Fast"

  case "TiltedStraight_Fast" [simulation]
    description: Sample scenario consisting in a straight line tilted by 135 degrees in the X-Y plane.
      Speed: 100 km/h.
    model Dynamic_obstacle_avoidance, harness Path_Following_Harness (for Dynamic_obstacle_avoidance/Subsystem)
    pre-load callback: same code as in pre-load callback of case "TiltedStraight_Fast"

  case "1000mCurve_Slow" [simulation]
    description: Sample scenario consisting in a constant curve with radius 1000m.
      Speed set to 20 km/h.
    model Dynamic_obstacle_avoidance, harness Path_Following_Harness (for Dynamic_obstacle_avoidance/Subsystem)
    pre-load callback: same code as in pre-load callback of case "1000mCurve_Slow"

  case "100mCurve_Slow" [simulation]
    description: Sample scenario consisting in a constant curve with radius 100m.
      Speed: 10 km/h.
    model Dynamic_obstacle_avoidance, harness Path_Following_Harness (for Dynamic_obstacle_avoidance/Subsystem)
    pre-load callback: same code as in pre-load callback of case "100mCurve_Slow"

  case "1000mCurve_Fast" [simulation]
    description: Sample scenario consisting in a constant curve with 1000m radius.
      Speed: 100 km/h.
    model Dynamic_obstacle_avoidance, harness Path_Following_Harness (for Dynamic_obstacle_avoidance/Subsystem)
    pre-load callback: same code as in pre-load callback of case "1000mCurve_Fast"

  case "100mCurve_Fast" [simulation]
    description: Sample scenario consisting of a constant curve with radius 100m.
      Speed: 100 km/h.
    model Dynamic_obstacle_avoidance, harness Path_Following_Harness (for Dynamic_obstacle_avoidance/Subsystem)
    pre-load callback: same code as in pre-load callback of case "100mCurve_Fast"

  case "Adriatic Highway A 14" [simulation]
    description: This scenario is taken from the A14 Highway which is a straight road for the most of it, with some high-speed corners.
      We simulate this scenario at 100 km/h.
    model Dynamic_obstacle_avoidance, harness Path_Following_Harness (for Dynamic_obstacle_avoidance/Subsystem)
    parameter set "Parameter Set 1" (off):
      WOV = [30 30 10 30] (off)  % base workspace
    parameter set "Parameter Set 2" (off):
      WOV = [30 30 0 30] (off)  % base workspace
    parameter set "Parameter Set 3" (off):
      WOV = [30 30 1 30] (off)  % base workspace
    parameter set "Parameter Set 4" (off):
      WOV = [30 30 100 30] (off)  % base workspace
    pre-load callback: same code as in pre-load callback of case "Adriatic Highway A 14"
    iterations:
      Iteration1 (disabled): ParameterSet "Parameter Set 1"
      Iteration2 (disabled): ParameterSet "Parameter Set 2"
      Iteration3 (disabled): ParameterSet "Parameter Set 3"
      Iteration4 (disabled): ParameterSet "Parameter Set 4"

  case "Indianapolis Speedway" [simulation]
    description: This scenario is taken from the Indianapolis Speedway. We simulate it at 100 km/h.
    model Dynamic_obstacle_avoidance, harness Path_Following_Harness (for Dynamic_obstacle_avoidance/Subsystem)
    parameter set "Parameter Set 1" (off):
      WOV = [30 30 10 30] (off)  % base workspace
    parameter set "Parameter Set 2" (off):
      WOV = [30 30 0 30] (off)  % base workspace
    parameter set "Parameter Set 3" (off):
      WOV = [30 30 1 30] (off)  % base workspace
    parameter set "Parameter Set 4" (off):
      WOV = [30 30 100 30] (off)  % base workspace
    pre-load callback: same code as in pre-load callback of case "Indianapolis Speedway"
    iterations:
      Iteration1 (disabled): ParameterSet "Parameter Set 1"
      Iteration2 (disabled): ParameterSet "Parameter Set 2"
      Iteration3 (disabled): ParameterSet "Parameter Set 3"
      Iteration4 (disabled): ParameterSet "Parameter Set 4"

suite "Ford E150"
  setup callback:
    param = loadParameters(3);

  case "Puglia" [simulation]
    description: This scenario is taken from an Highway and it is a road that is straigth for the most with some smooth corners.
      In this test we try to follow the path with a speed of 40 km/h.
    model Dynamic_obstacle_avoidance, harness Path_Following_Harness (for Dynamic_obstacle_avoidance/Subsystem)
    pre-load callback: same code as in pre-load callback of case "Puglia"

  case "Switzerland" [simulation]
    description: This is the slowest scenario considered, with lots of corners one after another.
      We try to follow this scenario with 15 km/h speed.
    model Dynamic_obstacle_avoidance, harness Path_Following_Harness (for Dynamic_obstacle_avoidance/Subsystem)
    parameter set "Parameter Set 1" (off):
      WOV = [30 30 10 30] (off)  % base workspace
    parameter set "Parameter Set 2" (off):
      WOV = [30 30 0 30] (off)  % base workspace
    parameter set "Parameter Set 3" (off):
      WOV = [30 30 1 30] (off)  % base workspace
    parameter set "Parameter Set 4" (off):
      WOV = [30 30 100 30] (off)  % base workspace
    pre-load callback: same code as in pre-load callback of case "Switzerland"
    iterations:
      Iteration1 (disabled): ParameterSet "Parameter Set 1"
      Iteration2 (disabled): ParameterSet "Parameter Set 2"
      Iteration3 (disabled): ParameterSet "Parameter Set 3"
      Iteration4 (disabled): ParameterSet "Parameter Set 4"

  case "Straight_Slow" [simulation]
    description: Sample scenario consisting in a straight line.
      Speed 10 km/h.
    model Dynamic_obstacle_avoidance, harness Path_Following_Harness (for Dynamic_obstacle_avoidance/Subsystem)
    pre-load callback: same code as in pre-load callback of case "Straight_Slow"

  case "TiltedStraight_Slow" [simulation]
    description: Sample scenario consisting in a straight line with a direction of 45 degrees in the X-Y plane.
      Speed 10 km/h.
    model Dynamic_obstacle_avoidance, harness Path_Following_Harness (for Dynamic_obstacle_avoidance/Subsystem)
    pre-load callback: same code as in pre-load callback of case "TiltedStraight_Slow"

  case "Campania" [simulation]
    description: This scenario is made up by a sequence of smooth corners.
      We try to follow this path with 30 km/h speed.
    model Dynamic_obstacle_avoidance, harness Path_Following_Harness (for Dynamic_obstacle_avoidance/Subsystem)
    parameter set "Parameter Set 1" (off):
      WOV = [30 30 10 30] (off)  % base workspace
    parameter set "Parameter Set 2" (off):
      WOV = [30 30 0 30] (off)  % base workspace
    parameter set "Parameter Set 3" (off):
      WOV = [30 30 1 30] (off)  % base workspace
    parameter set "Parameter Set 4" (off):
      WOV = [30 30 100 30] (off)  % base workspace
    pre-load callback: same code as in pre-load callback of case "Campania"
    iterations:
      Iteration1 (disabled): ParameterSet "Parameter Set 1"
      Iteration2 (disabled): ParameterSet "Parameter Set 2"
      Iteration3 (disabled): ParameterSet "Parameter Set 3"
      Iteration4 (disabled): ParameterSet "Parameter Set 4"

  case "Straight_Fast" [simulation]
    description: Sample scenario consisiting in a straight line.
      Speed: 100 km/h.
    model Dynamic_obstacle_avoidance, harness Path_Following_Harness (for Dynamic_obstacle_avoidance/Subsystem)
    pre-load callback: same code as in pre-load callback of case "Straight_Fast"

  case "TiltedStraight_Fast" [simulation]
    description: Sample scenario consisting in a straight line tilted by 135 degrees in the X-Y plane.
      Speed: 100 km/h.
    model Dynamic_obstacle_avoidance, harness Path_Following_Harness (for Dynamic_obstacle_avoidance/Subsystem)
    pre-load callback: same code as in pre-load callback of case "TiltedStraight_Fast"

  case "1000mCurve_Slow" [simulation]
    description: Sample scenario consisting in a constant curve with radius 1000m.
      Speed set to 20 km/h.
    model Dynamic_obstacle_avoidance, harness Path_Following_Harness (for Dynamic_obstacle_avoidance/Subsystem)
    pre-load callback: same code as in pre-load callback of case "1000mCurve_Slow"

  case "100mCurve_Slow" [simulation]
    description: Sample scenario consisting in a constant curve with radius 100m.
      Speed: 10 km/h.
    model Dynamic_obstacle_avoidance, harness Path_Following_Harness (for Dynamic_obstacle_avoidance/Subsystem)
    pre-load callback: same code as in pre-load callback of case "100mCurve_Slow"

  case "1000mCurve_Fast" [simulation]
    description: Sample scenario consisting in a constant curve with 1000m radius.
      Speed: 100 km/h.
    model Dynamic_obstacle_avoidance, harness Path_Following_Harness (for Dynamic_obstacle_avoidance/Subsystem)
    pre-load callback: same code as in pre-load callback of case "1000mCurve_Fast"

  case "100mCurve_Fast" [simulation]
    description: Sample scenario consisting of a constant curve with radius 100m.
      Speed: 100 km/h.
    model Dynamic_obstacle_avoidance, harness Path_Following_Harness (for Dynamic_obstacle_avoidance/Subsystem)
    pre-load callback: same code as in pre-load callback of case "100mCurve_Fast"

  case "Adriatic Highway A 14" [simulation]
    description: This scenario is taken from the A14 Highway which is a straight road for the most of it, with some high-speed corners.
      We simulate this scenario at 100 km/h.
    model Dynamic_obstacle_avoidance, harness Path_Following_Harness (for Dynamic_obstacle_avoidance/Subsystem)
    parameter set "Parameter Set 1" (off):
      WOV = [30 30 10 30] (off)  % base workspace
    parameter set "Parameter Set 2" (off):
      WOV = [30 30 0 30] (off)  % base workspace
    parameter set "Parameter Set 3" (off):
      WOV = [30 30 1 30] (off)  % base workspace
    parameter set "Parameter Set 4" (off):
      WOV = [30 30 100 30] (off)  % base workspace
    pre-load callback: same code as in pre-load callback of case "Adriatic Highway A 14"
    iterations:
      Iteration1 (disabled): ParameterSet "Parameter Set 1"
      Iteration2 (disabled): ParameterSet "Parameter Set 2"
      Iteration3 (disabled): ParameterSet "Parameter Set 3"
      Iteration4 (disabled): ParameterSet "Parameter Set 4"

  case "Indianapolis Speedway" [simulation]
    description: This scenario is taken from the Indianapolis Speedway. We simulate it at 100 km/h.
    model Dynamic_obstacle_avoidance, harness Path_Following_Harness (for Dynamic_obstacle_avoidance/Subsystem)
    parameter set "Parameter Set 1" (off):
      WOV = [30 30 10 30] (off)  % base workspace
    parameter set "Parameter Set 2" (off):
      WOV = [30 30 0 30] (off)  % base workspace
    parameter set "Parameter Set 3" (off):
      WOV = [30 30 1 30] (off)  % base workspace
    parameter set "Parameter Set 4" (off):
      WOV = [30 30 100 30] (off)  % base workspace
    pre-load callback: same code as in pre-load callback of case "Indianapolis Speedway"
    iterations:
      Iteration1 (disabled): ParameterSet "Parameter Set 1"
      Iteration2 (disabled): ParameterSet "Parameter Set 2"
      Iteration3 (disabled): ParameterSet "Parameter Set 3"
      Iteration4 (disabled): ParameterSet "Parameter Set 4"

suite "Suzuki Samurai"
  setup callback:
    param = loadParameters(4);

  case "Puglia" [simulation]
    description: This scenario is taken from an Highway and it is a road that is straigth for the most with some smooth corners.
      In this test we try to follow the path with a speed of 40 km/h.
    model Dynamic_obstacle_avoidance, harness Path_Following_Harness (for Dynamic_obstacle_avoidance/Subsystem)
    pre-load callback: same code as in pre-load callback of case "Puglia"

  case "Switzerland" [simulation]
    description: This is the slowest scenario considered, with lots of corners one after another.
      We try to follow this scenario with 15 km/h speed.
    model Dynamic_obstacle_avoidance, harness Path_Following_Harness (for Dynamic_obstacle_avoidance/Subsystem)
    parameter set "Parameter Set 1" (off):
      WOV = [30 30 10 30] (off)  % base workspace
    parameter set "Parameter Set 2" (off):
      WOV = [30 30 0 30] (off)  % base workspace
    parameter set "Parameter Set 3" (off):
      WOV = [30 30 1 30] (off)  % base workspace
    parameter set "Parameter Set 4" (off):
      WOV = [30 30 100 30] (off)  % base workspace
    pre-load callback: same code as in pre-load callback of case "Switzerland"
    iterations:
      Iteration1 (disabled): ParameterSet "Parameter Set 1"
      Iteration2 (disabled): ParameterSet "Parameter Set 2"
      Iteration3 (disabled): ParameterSet "Parameter Set 3"
      Iteration4 (disabled): ParameterSet "Parameter Set 4"

  case "Straight_Slow" [simulation]
    description: Sample scenario consisting in a straight line.
      Speed 10 km/h.
    model Dynamic_obstacle_avoidance, harness Path_Following_Harness (for Dynamic_obstacle_avoidance/Subsystem)
    pre-load callback: same code as in pre-load callback of case "Straight_Slow"

  case "TiltedStraight_Slow" [simulation]
    description: Sample scenario consisting in a straight line with a direction of 45 degrees in the X-Y plane.
      Speed 10 km/h.
    model Dynamic_obstacle_avoidance, harness Path_Following_Harness (for Dynamic_obstacle_avoidance/Subsystem)
    pre-load callback: same code as in pre-load callback of case "TiltedStraight_Slow"

  case "Campania" [simulation]
    description: This scenario is made up by a sequence of smooth corners.
      We try to follow this path with 30 km/h speed.
    model Dynamic_obstacle_avoidance, harness Path_Following_Harness (for Dynamic_obstacle_avoidance/Subsystem)
    parameter set "Parameter Set 1" (off):
      WOV = [30 30 10 30] (off)  % base workspace
    parameter set "Parameter Set 2" (off):
      WOV = [30 30 0 30] (off)  % base workspace
    parameter set "Parameter Set 3" (off):
      WOV = [30 30 1 30] (off)  % base workspace
    parameter set "Parameter Set 4" (off):
      WOV = [30 30 100 30] (off)  % base workspace
    pre-load callback: same code as in pre-load callback of case "Campania"
    iterations:
      Iteration1 (disabled): ParameterSet "Parameter Set 1"
      Iteration2 (disabled): ParameterSet "Parameter Set 2"
      Iteration3 (disabled): ParameterSet "Parameter Set 3"
      Iteration4 (disabled): ParameterSet "Parameter Set 4"

  case "Straight_Fast" [simulation]
    description: Sample scenario consisiting in a straight line.
      Speed: 100 km/h.
    model Dynamic_obstacle_avoidance, harness Path_Following_Harness (for Dynamic_obstacle_avoidance/Subsystem)
    pre-load callback: same code as in pre-load callback of case "Straight_Fast"

  case "TiltedStraight_Fast" [simulation]
    description: Sample scenario consisting in a straight line tilted by 135 degrees in the X-Y plane.
      Speed: 100 km/h.
    model Dynamic_obstacle_avoidance, harness Path_Following_Harness (for Dynamic_obstacle_avoidance/Subsystem)
    pre-load callback: same code as in pre-load callback of case "TiltedStraight_Fast"

  case "1000mCurve_Slow" [simulation]
    description: Sample scenario consisting in a constant curve with radius 1000m.
      Speed set to 20 km/h.
    model Dynamic_obstacle_avoidance, harness Path_Following_Harness (for Dynamic_obstacle_avoidance/Subsystem)
    pre-load callback: same code as in pre-load callback of case "1000mCurve_Slow"

  case "100mCurve_Slow" [simulation]
    description: Sample scenario consisting in a constant curve with radius 100m.
      Speed: 10 km/h.
    model Dynamic_obstacle_avoidance, harness Path_Following_Harness (for Dynamic_obstacle_avoidance/Subsystem)
    pre-load callback: same code as in pre-load callback of case "100mCurve_Slow"

  case "1000mCurve_Fast" [simulation]
    description: Sample scenario consisting in a constant curve with 1000m radius.
      Speed: 100 km/h.
    model Dynamic_obstacle_avoidance, harness Path_Following_Harness (for Dynamic_obstacle_avoidance/Subsystem)
    pre-load callback: same code as in pre-load callback of case "1000mCurve_Fast"

  case "100mCurve_Fast" [simulation]
    description: Sample scenario consisting of a constant curve with radius 100m.
      Speed: 100 km/h.
    model Dynamic_obstacle_avoidance, harness Path_Following_Harness (for Dynamic_obstacle_avoidance/Subsystem)
    pre-load callback: same code as in pre-load callback of case "100mCurve_Fast"

  case "Adriatic Highway A 14" [simulation]
    description: This scenario is taken from the A14 Highway which is a straight road for the most of it, with some high-speed corners.
      We simulate this scenario at 100 km/h.
    model Dynamic_obstacle_avoidance, harness Path_Following_Harness (for Dynamic_obstacle_avoidance/Subsystem)
    parameter set "Parameter Set 1" (off):
      WOV = [30 30 10 30] (off)  % base workspace
    parameter set "Parameter Set 2" (off):
      WOV = [30 30 0 30] (off)  % base workspace
    parameter set "Parameter Set 3" (off):
      WOV = [30 30 1 30] (off)  % base workspace
    parameter set "Parameter Set 4" (off):
      WOV = [30 30 100 30] (off)  % base workspace
    pre-load callback: same code as in pre-load callback of case "Adriatic Highway A 14"
    iterations:
      Iteration1 (disabled): ParameterSet "Parameter Set 1"
      Iteration2 (disabled): ParameterSet "Parameter Set 2"
      Iteration3 (disabled): ParameterSet "Parameter Set 3"
      Iteration4 (disabled): ParameterSet "Parameter Set 4"

  case "Indianapolis Speedway" [simulation]
    description: This scenario is taken from the Indianapolis Speedway. We simulate it at 100 km/h.
    model Dynamic_obstacle_avoidance, harness Path_Following_Harness (for Dynamic_obstacle_avoidance/Subsystem)
    parameter set "Parameter Set 1" (off):
      WOV = [30 30 10 30] (off)  % base workspace
    parameter set "Parameter Set 2" (off):
      WOV = [30 30 0 30] (off)  % base workspace
    parameter set "Parameter Set 3" (off):
      WOV = [30 30 1 30] (off)  % base workspace
    parameter set "Parameter Set 4" (off):
      WOV = [30 30 100 30] (off)  % base workspace
    pre-load callback: same code as in pre-load callback of case "Indianapolis Speedway"
    iterations:
      Iteration1 (disabled): ParameterSet "Parameter Set 1"
      Iteration2 (disabled): ParameterSet "Parameter Set 2"
      Iteration3 (disabled): ParameterSet "Parameter Set 3"
      Iteration4 (disabled): ParameterSet "Parameter Set 4"

suite "Volkswagen Beetle"
  setup callback:
    param = loadParameters(5);

  case "Puglia" [simulation]
    description: This scenario is taken from an Highway and it is a road that is straigth for the most with some smooth corners.
      In this test we try to follow the path with a speed of 40 km/h.
    model Dynamic_obstacle_avoidance, harness Path_Following_Harness (for Dynamic_obstacle_avoidance/Subsystem)
    pre-load callback: same code as in pre-load callback of case "Puglia"

  case "Switzerland" [simulation]
    description: This is the slowest scenario considered, with lots of corners one after another.
      We try to follow this scenario with 15 km/h speed.
    model Dynamic_obstacle_avoidance, harness Path_Following_Harness (for Dynamic_obstacle_avoidance/Subsystem)
    parameter set "Parameter Set 1" (off):
      WOV = [30 30 10 30] (off)  % base workspace
    parameter set "Parameter Set 2" (off):
      WOV = [30 30 0 30] (off)  % base workspace
    parameter set "Parameter Set 3" (off):
      WOV = [30 30 1 30] (off)  % base workspace
    parameter set "Parameter Set 4" (off):
      WOV = [30 30 100 30] (off)  % base workspace
    pre-load callback: same code as in pre-load callback of case "Switzerland"
    iterations:
      Iteration1 (disabled): ParameterSet "Parameter Set 1"
      Iteration2 (disabled): ParameterSet "Parameter Set 2"
      Iteration3 (disabled): ParameterSet "Parameter Set 3"
      Iteration4 (disabled): ParameterSet "Parameter Set 4"

  case "Straight_Slow" [simulation]
    description: Sample scenario consisting in a straight line.
      Speed 10 km/h.
    model Dynamic_obstacle_avoidance, harness Path_Following_Harness (for Dynamic_obstacle_avoidance/Subsystem)
    pre-load callback: same code as in pre-load callback of case "Straight_Slow"

  case "TiltedStraight_Slow" [simulation]
    description: Sample scenario consisting in a straight line with a direction of 45 degrees in the X-Y plane.
      Speed 10 km/h.
    model Dynamic_obstacle_avoidance, harness Path_Following_Harness (for Dynamic_obstacle_avoidance/Subsystem)
    pre-load callback: same code as in pre-load callback of case "TiltedStraight_Slow"

  case "Campania" [simulation]
    description: This scenario is made up by a sequence of smooth corners.
      We try to follow this path with 30 km/h speed.
    model Dynamic_obstacle_avoidance, harness Path_Following_Harness (for Dynamic_obstacle_avoidance/Subsystem)
    parameter set "Parameter Set 1" (off):
      WOV = [30 30 10 30] (off)  % base workspace
    parameter set "Parameter Set 2" (off):
      WOV = [30 30 0 30] (off)  % base workspace
    parameter set "Parameter Set 3" (off):
      WOV = [30 30 1 30] (off)  % base workspace
    parameter set "Parameter Set 4" (off):
      WOV = [30 30 100 30] (off)  % base workspace
    pre-load callback: same code as in pre-load callback of case "Campania"
    iterations:
      Iteration1 (disabled): ParameterSet "Parameter Set 1"
      Iteration2 (disabled): ParameterSet "Parameter Set 2"
      Iteration3 (disabled): ParameterSet "Parameter Set 3"
      Iteration4 (disabled): ParameterSet "Parameter Set 4"

  case "Straight_Fast" [simulation]
    description: Sample scenario consisiting in a straight line.
      Speed: 100 km/h.
    model Dynamic_obstacle_avoidance, harness Path_Following_Harness (for Dynamic_obstacle_avoidance/Subsystem)
    pre-load callback: same code as in pre-load callback of case "Straight_Fast"

  case "TiltedStraight_Fast" [simulation]
    description: Sample scenario consisting in a straight line tilted by 135 degrees in the X-Y plane.
      Speed: 100 km/h.
    model Dynamic_obstacle_avoidance, harness Path_Following_Harness (for Dynamic_obstacle_avoidance/Subsystem)
    pre-load callback: same code as in pre-load callback of case "TiltedStraight_Fast"

  case "1000mCurve_Slow" [simulation]
    description: Sample scenario consisting in a constant curve with radius 1000m.
      Speed set to 20 km/h.
    model Dynamic_obstacle_avoidance, harness Path_Following_Harness (for Dynamic_obstacle_avoidance/Subsystem)
    pre-load callback: same code as in pre-load callback of case "1000mCurve_Slow"

  case "100mCurve_Slow" [simulation]
    description: Sample scenario consisting in a constant curve with radius 100m.
      Speed: 10 km/h.
    model Dynamic_obstacle_avoidance, harness Path_Following_Harness (for Dynamic_obstacle_avoidance/Subsystem)
    pre-load callback: same code as in pre-load callback of case "100mCurve_Slow"

  case "1000mCurve_Fast" [simulation]
    description: Sample scenario consisting in a constant curve with 1000m radius.
      Speed: 100 km/h.
    model Dynamic_obstacle_avoidance, harness Path_Following_Harness (for Dynamic_obstacle_avoidance/Subsystem)
    pre-load callback: same code as in pre-load callback of case "1000mCurve_Fast"

  case "100mCurve_Fast" [simulation]
    description: Sample scenario consisting of a constant curve with radius 100m.
      Speed: 100 km/h.
    model Dynamic_obstacle_avoidance, harness Path_Following_Harness (for Dynamic_obstacle_avoidance/Subsystem)
    pre-load callback: same code as in pre-load callback of case "100mCurve_Fast"

  case "Adriatic Highway A 14" [simulation]
    description: This scenario is taken from the A14 Highway which is a straight road for the most of it, with some high-speed corners.
      We simulate this scenario at 100 km/h.
    model Dynamic_obstacle_avoidance, harness Path_Following_Harness (for Dynamic_obstacle_avoidance/Subsystem)
    parameter set "Parameter Set 1" (off):
      WOV = [30 30 10 30] (off)  % base workspace
    parameter set "Parameter Set 2" (off):
      WOV = [30 30 0 30] (off)  % base workspace
    parameter set "Parameter Set 3" (off):
      WOV = [30 30 1 30] (off)  % base workspace
    parameter set "Parameter Set 4" (off):
      WOV = [30 30 100 30] (off)  % base workspace
    pre-load callback: same code as in pre-load callback of case "Adriatic Highway A 14"
    iterations:
      Iteration1 (disabled): ParameterSet "Parameter Set 1"
      Iteration2 (disabled): ParameterSet "Parameter Set 2"
      Iteration3 (disabled): ParameterSet "Parameter Set 3"
      Iteration4 (disabled): ParameterSet "Parameter Set 4"

  case "Indianapolis Speedway" [simulation]
    description: This scenario is taken from the Indianapolis Speedway. We simulate it at 100 km/h.
    model Dynamic_obstacle_avoidance, harness Path_Following_Harness (for Dynamic_obstacle_avoidance/Subsystem)
    parameter set "Parameter Set 1" (off):
      WOV = [30 30 10 30] (off)  % base workspace
    parameter set "Parameter Set 2" (off):
      WOV = [30 30 0 30] (off)  % base workspace
    parameter set "Parameter Set 3" (off):
      WOV = [30 30 1 30] (off)  % base workspace
    parameter set "Parameter Set 4" (off):
      WOV = [30 30 100 30] (off)  % base workspace
    pre-load callback: same code as in pre-load callback of case "Indianapolis Speedway"
    iterations:
      Iteration1 (disabled): ParameterSet "Parameter Set 1"
      Iteration2 (disabled): ParameterSet "Parameter Set 2"
      Iteration3 (disabled): ParameterSet "Parameter Set 3"
      Iteration4 (disabled): ParameterSet "Parameter Set 4"