test file "MPC_L"

suite "New Test Suite 1"

  case "MPC_L Setup" [baseline]
    description: This test is aimed to try to find a feasible and stable configuration for the MPC when it comes to slow speed scenarios
    model Dynamic_obstacle_avoidance_L
    parameter set "Parameter Set 1" (off): Ts = 0.01, WOV = [30 30 8 30], p = 10  % base workspace
    parameter set "Parameter Set 2" (off): Ts = 0.01, WOV = [30 30 5 30], p = 8  % base workspace
    parameter set "Parameter Set 3" (off): Ts = 0.01, WOV = [30 30 0 30], p = 10  % base workspace
    parameter set "Parameter Set 4": Ts = 0.005, WOV = [30 30 8 30], p = 10  % base workspace
    parameter set "Parameter Set 5" (off): Ts = 0.02, WOV = [30 30 8 30], p = 10  % base workspace
    parameter set "Parameter Set 6" (off): Ts = 0.01, WOV = [30 30 0 0], p = 10  % base workspace
    parameter set "Parameter Set 7" (off): Ts = 0.01, WOV = [30 30 0 30], p = 8  % base workspace
    parameter set "Parameter Set 8" (off): Ts = 0.005, WOV = [30 30 8 30], p = 8  % base workspace
    parameter set "Parameter Set 9" (off): Ts = 0.005, WOV = [30 30 8 30], p = 8  % base workspace
    parameter set "Parameter Set 10" (off): Ts = 0.01, WOV = [30 30 8 30], p = 15  % base workspace
    parameter set "Parameter Set 11" (off): Ts = 0.005, WOV = [30 30 8 30], p = 15  % base workspace
    parameter set "Parameter Set 12" (off): Ts = 0.01, WOV = [30 30 0 0], p = 15  % base workspace
    iterations:
      Iteration1: ParameterSet "Parameter Set 1"
      Iteration2: ParameterSet "Parameter Set 2"
      Iteration3: ParameterSet "Parameter Set 3"
      Iteration4: ParameterSet "Parameter Set 4"
      Iteration5: ParameterSet "Parameter Set 5"
      Iteration6: ParameterSet "Parameter Set 6"
      Iteration7: ParameterSet "Parameter Set 7"
      Iteration8: ParameterSet "Parameter Set 8"
      Iteration9: ParameterSet "Parameter Set 9"
      Iteration10: ParameterSet "Parameter Set 10"
      Iteration11: ParameterSet "Parameter Set 11"
      Iteration12: ParameterSet "Parameter Set 12"